% Simulink data dictionary Driver.sldd

DriverAeroRes = 0.5
DriverDrivelineRes = 2.5
DriverInitialGear = 0
DriverRollRes = 200
DriverShiftTime = 0.1
DriverTractiveForce = 15000
DriverWheelRange = 1.047198
DriverPreviewDist = 4
DriverTimeConst = 0.3
DriverFrontCornerStiff = 40000
DriverRearCornerStiff = 40000