% Simulink data dictionary Scenario.sldd

ScnStartTime = 2
ScnLongVelRef = 35
ScnLongVelUnit = "mph"
ScnSSSweepTime = 30
ScnDLCGateLongPos = 175
ScnDLCLongRefStartPos = 2
ScnDLCVehicleWidth = 2
ScnISHandwheelRate = 13.5
ScnISLatAccStop = "on"
ScnISMaxLatAccel = 0.5
ScnISSteerHoldTime = 2
ScnSteerDir = "off"
ScnSSSteerAmp = 90
ScnSSFinalFreq = 0.7
ScnSDSteerFreq = 0.7
ScnSDSteerAmp = 90
ScnSDDwellTime = 0.5
ScnCRRadius = 100
ScnCRMaxLatAccel = 0.5
ScnCRLatAccStop = "off"
ScnFHSteerSpeed = 720
ScnFHUseRollRate = "off"
ScnFHInitialDwellTime = 0.5
ScnFHCounterDwellTime = 3
ScnFHReturnTime = 2
ScnFHRollRateZeroCross = 1.5
ScnDLCLatRefOffset = 5.7
ScnDLCLongRefBpt = [0 5.875 6 18 33 33.5 45 50 60]
ScnDLCLatRef = [0 0 -5 -3.875 -3.5 1 0 0 0]
ScnISMaxHandwheelAng = 270
ScnSimTime = 765