% Simulink data dictionary Trailer.sldd

PlntHtchCxy = 39584.07
PlntHtchCz = 16747.11
PlntHtchF0z = 7263.173
PlntHtchKxy = 276348.9
PlntHtchKz = 116916.9
PlntTraAeroDragCff = 0.15
PlntTraAeroFrntArea = 8.16
PlntTraAeroLiftCff = 0.1
PlntTraAeroPitchCff = 0.1
PlntTraCGHgtAxl = 0.5
PlntTraCzWhlAxl = 11490.97
PlntTraDstCGFrntAxl = 5.5
PlntTraDstCGRearAxl = 6.75
PlntTraF0zWhlAxl = 2907
PlntTraFrntUnsprgMass = 100
PlntTraFzFlt = 10
PlntTraHtchDstFrnt = 7.5
PlntTraHtchHgtAxlFrnt = 0.5
PlntTraInitLatVel = 0
PlntTraInitLongVel = 0
PlntTraInitPitchAng = 0
PlntTraInitPitchRate = 0
PlntTraInitRollAng = 0
PlntTraInitRollRate = 0
PlntTraInitVertPos = 0
PlntTraInitVertVel = 0
PlntTraInitYawAng = 0
PlntTraInitYawRate = 0
PlntTraKzWhlAxl = 138031.6
PlntTraMass = 1750
PlntTraNumWhlFrntAxl = 2
PlntTraNumWhlRearAxl = 2
PlntTraPitchMomentInertia = 24419.98
PlntTraRearUnsprgMass = 100
PlntTraRollMomentInertia = 5491.109
PlntTraRollResCffa = 196
PlntTraRollResCffb = 2.232
PlntTraSuspCz = 11418.48
PlntTraSuspF0z = 4952.163
PlntTraSuspHmax = 0.25
PlntTraSuspKz = 79716.04
PlntTraTrckWdth = 2.55
PlntTraYawMomentInertia = 26240.47
PlntTraNumWhlMiddleAxl = 2
PlntTraDstCGMiddleAxl = 6.125
PlntTraInitLongPos = -8.5
PlntTraInitLatPos = 0