% Simulink data dictionary VehScenario.sldd

XGate = 35
t_start = 3
xdot_r = 30
vehW = 2
latoff = 0
latRefbp = [0 2 12 25.5 36.5 49 61]
latRef = [0 0 -0.75 -3.5 -2.5 0 0]
X_o = 0
Y_o = 0
Z_o = 0
phi_o = 0
psi_o = 0
theta_o = 0
omega_hwHandwheel_rate = 13.5
theta_max = 90
t_stop = 60
ay_max = 0.5
t_sweep = 30
theta_hw = 90
theta_hw_final = 0.7
steerF = 0.7
steerA = 90
tdwell = 0.5
R = 100
cr_ay_max = 0.5