% Simulink data dictionary diffData.sldd

Diff_EffMap = [0.94 0.94 0.92 0.9 0.9 0.9 0.9 0.88 0.88 0.88 0.88
 0.96 0.94 0.94 0.92 0.92 0.92 0.92 0.9 0.9 0.88 0.88
 0.96 0.94 0.94 0.94 0.94 0.94 0.94 0.92 0.92 0.9 0.9
 0.98 0.96 0.96 0.96 0.96 0.96 0.96 0.94 0.94 0.92 0.92
 0.98 0.98 0.98 0.98 0.98 0.98 0.98 0.96 0.94 0.94 0.94
 0.98 0.98 0.98 0.98 0.98 0.98 0.98 0.96 0.96 0.94 0.94
 0.98 0.98 0.98 0.98 0.98 0.98 0.98 0.96 0.96 0.96 0.94
 0.98 0.98 0.98 0.98 0.98 0.98 0.98 0.96 0.96 0.96 0.94
 0.98 0.98 0.98 0.98 0.98 0.98 0.98 0.98 0.96 0.96 0.94
 0.98 0.98 0.98 0.98 0.98 0.98 0.98 0.98 0.96 0.96 0.96
 0.98 0.98 0.98 0.98 0.98 0.98 0.98 0.98 0.96 0.96 0.96
 0.98 0.98 0.98 0.98 0.98 0.98 0.98 0.98 0.96 0.96 0.96
 0.98 0.98 0.98 0.98 0.98 0.98 0.98 0.98 0.96 0.96 0.96
 0.98 0.98 0.98 0.98 0.98 0.98 0.98 0.98 0.96 0.96 0.96
 0.98 0.98 0.98 0.98 0.98 0.98 0.98 0.98 0.96 0.96 0.96]

Diff_Spd_BrkPts = [500 750 1000 1250 1500 1750 2000 2250 2500 2750 3000]
Diff_Trq_BrkPts = [20; 25; 30; 35; 40; 45; 50; 55; 60; 65; 70; 75; 80; 85; 90]